# Grasshopper definition driverless_LIM_prototype.gh (Grasshopper 1.0.7)

file_path = FilePath("C:\Users\richi\omen-richiebao_s\omen_code\driverlessCity_LIM\database\driverlesscity_sqlit.db")
file_path_2 = FilePath("C:\Users\richi\omen-richiebao_s\omen_code\driverlessCity_LIM\database\driverlesscity_sqlit.db")
point = Point([Point(17.43733602, -10.50332197, 0), Point(14.66925011, -20.24288349, 0), Point(22.05081253, -36.44131212, 0), Point(13.74655481, -49.56408974, 0), Point(21.84576913, -60.94399847, 0), Point(19.59029172, -65.86504008, 0), Point(20.20542192, -79.1928611, 0)])
sql_read = SQLRead(database_sql=file_path_2, table="table_location_phmi")  # -> out, output
# ---------- sql_read: Python ----------
"""Read SQL table.
    Inputs:
        database_sql: SQL database file path
        table: Specify a table
    Output:
        output: table content"""

__author__ = "Richie Bao-Chicago.IIT(driverless city project)"
__version__ = "2020.11.30"

ghenv.Component.Name = 'SQL read'
ghenv.Component.NickName = 'SQL read'
ghenv.Component.Message = '0.0.1'
ghenv.Component.Category = 'driverless-city'
ghenv.Component.SubCategory = '0 :: SQL'
ghenv.Component.AdditionalHelpFromDocStrings = '5'

import rhinoscriptsyntax as rs
import sqlite3
import ghpythonlib.treehelpers as th
import Rhino

conn=sqlite3.connect(database_sql)
with conn:
    cur = conn.cursor()
    cur.execute("SELECT * FROM %s"%table)
    rows = cur.fetchall()


layerTree = th.list_to_tree(rows, source=[0,])
output=layerTree
# ---------- end sql_read ----------
sql_read_2 = SQLRead(database_sql=file_path, table="table_landmark")  # -> out, output; same code as sql_read
pts_attri = PointsAttribute(points=point, attribute=Slider(10, range=0..100))  # -> out, pts_attri; inputs points: list
# ---------- pts_attri: Python ----------
"""Provides a scripting component.
    Inputs:
        points: Specify some points with an attribute
        attribute: Configure points' attribute
    Output:
        pts_attri: points given with certian attribute"""

__author__ = "Richie Bao-Chicago.IIT(driverless city project)"
__version__ = "2020.11.30"

ghenv.Component.Name = 'points attribute'
ghenv.Component.NickName = 'pts attri'
ghenv.Component.Message = '0.0.1'
ghenv.Component.Category = 'driverless-city'
ghenv.Component.SubCategory = '1 :: SQL'
ghenv.Component.AdditionalHelpFromDocStrings = '5'

import rhinoscriptsyntax as rs
import ghpythonlib.treehelpers as th
pts_coordi=[[c for c in rs.PointCoordinates(pt)]+[attribute] for pt in points]
pts_attri=th.list_to_tree(pts_coordi, source=[0,])
# ---------- end pts_attri ----------
panel = Panel("""x
y
z
attribute""")
point_2 = Point(Point(18.18028534, -4.825244709, 0))
rectangle = Rectangle(Plane=point_2, XSize=Slider(9.317, range=0..50), YSize=Slider(22.917, range=0..50), Radius=0)  # -> Rectangle, Length
unit_z = UnitZ(Factor=Slider(8.184, range=0..50))
list_item = ListItem(List=sql_read.output, Index="1", Wrap=True)  # -> flatten(Item)
list_item_2 = ListItem(List=sql_read.output, Index="2", Wrap=True)  # -> flatten(Item)
list_item_3 = ListItem(List=sql_read_2.output, Index="1", Wrap=True)  # -> flatten(Item)
sql_dump = SQLDump(database_sql=file_path, pts_attri=pts_attri.pts_attri, field=panel, table_name="pts_attri")  # -> out, prompt; inputs pts_attri: tree, field: list
# ---------- sql_dump: Python ----------
__author__ = "Richie Bao-Chicago.IIT(driverless city project)"
__version__ = "2020.11.30"

ghenv.Component.Name = 'SQL dump'
ghenv.Component.NickName = 'SQL dump'
ghenv.Component.Message = '0.0.1'
ghenv.Component.Category = 'driverless-city'
ghenv.Component.SubCategory = '1 :: SQL'
ghenv.Component.AdditionalHelpFromDocStrings = '5'

import rhinoscriptsyntax as rs
import rhinoscriptsyntax as rs
import sqlite3
import ghpythonlib.treehelpers as th
import Rhino

def create_table(conn, create_table_sql):
    """ create a table from the create_table_sql statement
    :param conn: Connection object
    :param create_table_sql: a CREATE TABLE statement
    :return:
    """
    try:
        c = conn.cursor()
        c.execute(create_table_sql)
    except Error as e:
        print(e)
        
def data2sqlite(conn,table_name,data):
    with conn:
        conn.executemany("insert into %s(x, y,z,attribute) values (?,?,?,?)"%table_name,data)
        conn.commit()
        
        
        

pts_attri_nested_list=th.tree_to_list(pts_attri)

conn=sqlite3.connect(database_sql)
sql_create_table = """CREATE TABLE IF NOT EXISTS %s (
                                id integer PRIMARY KEY AUTOINCREMENT,
                                %s real NOT NULL,
                                %s real NOT NULL,
                                %s real NOT NULL,
                                %s real NOT NULL

                            );"""%(table_name,field[0],field[1],field[2],field[3])

create_table(conn, sql_create_table)

data2sqlite(conn,table_name,pts_attri_nested_list)
prompt="dumpped the data!"
# ---------- end sql_dump ----------
list_item_4 = ListItem(List=sql_read_2.output, Index="2", Wrap=True)  # -> flatten(Item)
extrude = Extrude(Base=rectangle.Rectangle, Direction=unit_z)
construct_point = ConstructPoint(XCoordinate=list_item_3, YCoordinate=list_item_4, ZCoordinate=0)
construct_point_2 = ConstructPoint(XCoordinate=list_item, YCoordinate=list_item_2, ZCoordinate=0)
panel_2 = Panel(pts_attri.pts_attri)
panel_3 = Panel(sql_dump.prompt)
panel_4 = Panel(sql_read_2.output)
cap_holes = CapHoles(Brep=extrude)
panel_5 = Panel(cap_holes)
